# Grasshopper definition ComposGH_Example_BS_01.gh (Grasshopper 1.0.7)
# Copyright: Arup
# plug-ins: Compos

# ---- group: Slab / Concrete material and dimensions
number_slider = Slider(1800, range=0..10000)
bscmt = BSConcreteMaterial(ImposedLoadPercentage_=0.33, Grade="C70", Weight_Type="Normal", Density_Unit="KilogramPerCubicMeter")
slabdimension = CreateSlabDimension(
    OverallDepth_mm=Slider(165, range=0..1000),
    AvailableWidthLeft_mm=number_slider,
    AvailableWidthRight_mm=number_slider,
    Tapered=False,
    Unit="Millimeter")

# ---- group: Beam / Geometry
pt = ConstructPoint(XCoordinate=0, YCoordinate=0, ZCoordinate=0)
pt_2 = ConstructPoint(XCoordinate=0, YCoordinate=Slider(8, range=0..10), ZCoordinate=0)
ln = Line(StartPoint=pt, EndPoint=pt_2)

# ---- group: Beam / Profile
profile = CreateProfile(
    NumberOfInputs=0,
    catalogueIndex=2,
    inclSS=False,
    lengthUnit="Centimeter",
    mode="Catalogue",
    Profile_type="Catalogue",
    Catalogue="British",
    Type="Wide flange beams(HE) - EN10365:2017",
    Profile="BSI-HE HE180AA",
    typeIndex=249)
beamsection = CreateBeamSection(BeamSection=profile, TaperNext=False, Unit="Meter")

# ---- group: Beam / Restraints - construction stage and final
supports = CreateSupports(SecMemIntermRes=True, FlngsFreeRotEnds=True, Intermediate_Sup="Mid-Span", Unit="Meter")
restraints = CreateRestraints(TopFlngLatResConstrStg=True, ConstructionStageSupports=supports)

# ---- group: Beam / Material grade
stdsmt = StandardSteelMaterial(Grade="S275")

# ---- group: Slab / Decking
rad = Radians(Degrees="90")
deckconf = DeckConfig(Angle=rad, Discontinaus=Toggle(True), Welded=Toggle(False))
decking = CatalogueDecking(DeckingConfig=deckconf, Type="RLD", Decking="Ribdeck AL (0.9)", Steel_Type="S280")

# ---- group: Slab / Mesh and transverse rebar
reinforcementmaterial = CreateReinforcementMaterial(Grade="BS_460T", Unit="Megapascal")
meshreinforcement = CreateMeshReinforcement(Cover_cm=Slider(2.5, range=0..10), Rotated=False, Standard_Mesh="A393", Unit="Centimeter")

# ---- group: Beam
beam = CreateBeam(Line_m=ln, Restraints=restraints, SteelMaterial=stdsmt, BeamSectionS=beamsection, Unit="Meter")

# ----
transversereinforcement = CreateTransverseReinforcement(ReinforcementMaterial=reinforcementmaterial)

# ---- group: Stud / Stud dimensions
studdimsstandard = StandardStudDimension(Standard_Size="Ø19/100mm")

# ---- group: Stud / Specification
studspecs = CreateStudSpecs(Welded=True, Unit="Centimeter")

# ---- group: Slab
slab = CreateSlab(
    ConcreteMaterial=bscmt,
    SlabDimensionS=slabdimension,
    TransverseReinforcement=transversereinforcement,
    MeshReinforcement=meshreinforcement,
    Decking=decking)

# ---- group: Stud
stud = CreateStud(StudDimension=studdimsstandard, StudSpecs=studspecs, MinSaving=0.2, Spacing_Type="Min Num of Studs")

# ---- group: Load
uniformload = CreateUniformLoad(
    ConstDead_kN_m²=Slider(1, range=0..10),
    ConstLive_kN_m²=Slider(1.5, range=0..10),
    FinalDead_kN_m²=Slider(1, range=0..10),
    FinalLive_kN_m²=Slider(5, range=0..10),
    Distribution="Area",
    Unit="KilonewtonPerSquareMeter")

# ----
bm = Beam(beam)
stu = Stud(stud)
ld = Load(uniformload)
sla = Slab(slab)

# ---- group: Code settings
safetyfactors = CreateSafetyFactors(
    ConstDead=1.4,
    FinalDead=1.4,
    ConstLive=1.6,
    FinalLive=1.6,
    SteelBeam=1,
    ConcreteCompression=1.5,
    ConcreteShear=1.25,
    MetalDecking=1,
    ShearStud=1.25,
    Reinforcement=1.15)
designcode = CreateDesignCode(
    SafetyFactors=safetyfactors,
    checkbox0=False,
    checkbox1=True,
    checkbox2=True,
    checkbox3=False,
    checkbox4=False,
    checkbox5=False,
    checkbox6=False,
    checkbox7=False,
    checkboxname0="Beam propped during construction",
    checkboxname1="Include steel beam weight",
    checkboxname2="Include thin-flange sections",
    checkboxname3="Include concrete slab weight",
    checkboxname4="Consider shear deflection",
    Code="BS5950-3.1:1990+A1:2010")

# ---- group: Member (will automatically analyse)
name = Panel("MEMBER-1")
member = CreateMember(Beam=bm, Stud=stu, Slab=sla, LoadS=ld, DesignCode=designcode, Name=name)

# ---- group: DesignCriteria
cat = SectionCataloguesID(Catalogue="Europrofile:EP HE beams")
deflectionlimits = CreateDeflectionLimits(SpanDeflectionRatio_L_x=Slider(1000, range=0..1000), Unit="Millimeter")
deflectionlimits_2 = CreateDeflectionLimits(SpanDeflectionRatio_L_x=Slider(200, range=0..1000), Unit="Millimeter")
frequencylimits = CreateFrequencyLimits(MinRequired_Hz=Slider(4, range=0..10), DeadLoadIncl=Slider(1, range=0..1), LiveLoadIncl=Slider(0.1, range=0..1))
beamsizelimits = CreateBeamSizeLimits(
    MinDepth_m=Slider(0.2, range=0.2..1.5),
    MaxDepth_m=Slider(1, range=0.2..1.5),
    MinWidth_m=Slider(0.1, range=0.1..1.5),
    MaxWidth_m=Slider(0.5, range=0.2..1.5),
    Unit="Meter")
designcriteria = CreateDesignCriteria(
    BeamSizeLimits=beamsizelimits,
    CatalogueIDS=cat,
    ConstrDeadLoadLim=deflectionlimits,
    LiveLoadLim=deflectionlimits,
    TotalLoadLim=deflectionlimits_2,
    FrequencyLimits=frequencylimits,
    Optimise_Option="Min. Height")

# ---- group: Original Member
mem = Member(member)

# ----
panel = Panel(mem)

# ---- group: Designed Member
design = DesignMember(Member=mem, DesignCriteria=designcriteria)

# ---- group: Utilisation results
utilisations = UtilisationResults(Member=design)  # -> Moment, Shear, MomentConstruction, ShearConstruction, BucklingConstruction, Deflection, Deflection_2, TransverseShear, WebOpening
panel_2 = Panel([utilisations.Moment, utilisations.Shear, utilisations.MomentConstruction, utilisations.ShearConstruction, utilisations.BucklingConstruction, utilisations.Deflection, utilisations.Deflection_2, utilisations.TransverseShear, utilisations.WebOpening])

# ---- group: CodeCheckFails
code = CodeSatisfied(Member=mem)

# ---- group: CodeCheckSucceeded
code_2 = CodeSatisfied(Member=design)

# ----
panel_3 = Panel(code)
panel_4 = Panel(code_2)
mem_2 = Member(design)
mem_3 = Member(member)

# ---- group: Member force and deflection results
capacities = CapacityResults(Member=mem_3, Case="Sagging", Moment_Unit="KilonewtonMeter", Force_Unit="Kilonewton", Length_Unit="Centimeter")  # -> Moment, NeutralLinePosition, ShearCapacity, ShearBucklingCapacity, UsedShearCapacity, Positions
internal_forces = InternalForceResults(Member=mem_3, Case="FinalUltimate", Moment_Unit="KilonewtonMeter", Force_Unit="Kilonewton", Length_Unit="Meter")  # -> AxialForce, ShearForce, Moment, Positions
compositeprops = CompositeSectionProperties(Member=mem_3, Case="LongTerm", Unit="Centimeter")  # -> MomentOfInertia, NeutralLinePosition, Area, Positions
deflections = DeflectionResults(Member=mem_3, Unit="Meter")  # -> ConstructionDeadLoad, AdditionalDeadLoad, LiveLoad, Shrinkage, PostConstruction, Total, Positions
axial_force = Panel(internal_forces.AxialForce)
total_deflection = Panel(deflections.Total)
inertia = Panel(compositeprops.MomentOfInertia)
moment_capacity = Panel(capacities.Moment)
shear_force = Panel(internal_forces.ShearForce)
neutral_line = Panel(compositeprops.NeutralLinePosition)
neutral_line_2 = Panel(capacities.NeutralLinePosition)
moment = Panel(internal_forces.Moment)
area = Panel(compositeprops.Area)
shear_capacity = Panel(capacities.ShearCapacity)

# ---- group: Detailed results / Beam results
beamstress = BeamStressResults(Member=mem_2, Case="Final", Stress_Unit="Megapascal", Length_Unit="Meter")  # -> TopFlange, Web, BottomFlange, Positions
top_flange_stress = Panel(beamstress.TopFlange)
web_stress = Panel(beamstress.Web)
bottom_flng_stress = Panel(beamstress.BottomFlange)

# ---- group: Detailed results / Slab results
slabstress = SlabStressResults(Member=mem_2, Load="Final", Stress_Unit="Megapascal", Strain_Unit="MilliStrain", Length_Unit="Meter")  # -> Stress, Strain, Positions
concrete_stress = Panel(slabstress.Stress)
concrete_strain = Panel(slabstress.Strain)

# ---- group: Detailed results / Stud results
studresults = StudResults(Member=mem_2, Force_Unit="Kilonewton", Length_Unit="Meter")  # -> Rd, Sp, Ep, Sr, Er, RFI, RIA, _1Rd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
stud_capacity = Panel(studresults._1Rd)
stud_capacity_2 = Panel(studresults.Rd)
req_100_interaction = Panel(studresults.RFI)
provided_no_studs_start = Panel(studresults.Sp)
require_interaction = Panel(studresults.RIA)
provided_no_studs_end = Panel(studresults.Ep)
actual_interaction = Panel(studresults.IA)
required_no_studs_start = Panel(studresults.Sr)
stud_capacity_start = Panel(studresults.SRd)
required_no_studs_end = Panel(studresults.Er)
stud_capacity_end = Panel(studresults.ERd)

# ---- group: Detailed results / Rebar results
rebarresults = TransverseRebarResults(Member=mem_2, Force_Unit="Kilonewton", Length_Unit="Meter")  # -> Position, ControlSurface, EffPerimeter, TransverseShear, ShearResistance, ConcreteResistance, DeckingResistance, MeshBarResistance, RebarResistance, MaxAllowed
control_surface = Panel(rebarresults.ControlSurface)
effective_perimeter = Panel(rebarresults.EffPerimeter)
shear_force_2 = Panel(rebarresults.TransverseShear)
shear_resistance = Panel(rebarresults.ShearResistance)
max_allowed_resist = Panel(rebarresults.MaxAllowed)
critical_section_position = Panel(rebarresults.Position)
concrete_resist = Panel(rebarresults.ConcreteResistance)
deck_resistance = Panel(rebarresults.DeckingResistance)
mesh_bar_resist = Panel(rebarresults.MeshBarResistance)
rebar_resistance = Panel(rebarresults.RebarResistance)

# ---- group: Detailed results / Rebar layout (designed by Compos)
rebarresults_2 = TransverseRebarLayout(Member=mem_2, Unit="Millimeter")  # -> StartPosition, EndPosition, Diameter, Spacing, Cover, Area
start = Panel(rebarresults_2.StartPosition)
diameter = Panel(rebarresults_2.Diameter)
spacing = Panel(rebarresults_2.Spacing)
cover = Panel(rebarresults_2.Cover)
area_m = Panel(rebarresults_2.Area)
end = Panel(rebarresults_2.EndPosition)
